test file "dcmtrCTRL_PID_Tests"
  coverage: Decision, MCDC, Condition

suite "Simulation Test"

  case "Check MaxVolt Command" [simulation]
    model dcmtrCtrl_PID, harness dcmtrCtrl_PID_Harness0

  case "Check MaxVolt w Iterations" [simulation]
    model dcmtrCtrl_PID, harness dcmtrCtrl_PID_Harness1
    signal scenario: Test1 (dcmtrCtrl_PID_Harness1/Signal Editor)
    assessment "Assessment1": At any point of time, vCommand must be greater than or equal to single(-5) and less than or equal to single(5)
      vCommand: signal dcmtrCtrl_PID_Harness1/Output Conversion Subsystem, port 1
    iterations:
      Iteration1 (disabled): SignalBuilderGroup "SmoothStep"
      Iteration2 (disabled): SignalBuilderGroup "Step"
      Iteration3: SignalBuilderGroup "Test1"
      Iteration4: SignalBuilderGroup "Test2"
      Iteration5: SignalBuilderGroup "Test3"
      Iteration6: SignalBuilderGroup "Test4"
      Iteration7: SignalBuilderGroup "Test5"
      Iteration8: SignalBuilderGroup "Test6"

suite "Baseline Comparison"

  case "Performance under Varied MotorFriction" [baseline]
    model dcmtrCtrl_PID, harness dcmtrCtrl_PID_Harness1
    signal scenario: Test3 (dcmtrCtrl_PID_Harness1/Signal Editor)
    parameter set "Parameter Set 1": DCMtr_Fs = 25*1.1  % dcmtr_param.sldd
    baseline "Iteration5.mat": abs tol 0.01, rel tol 0.01
      v
      input
      motor_angle_rads

suite "Equivalence Test"
  setup callback:
    scrubSharedUtils

  case "Confirm SIL Equivalence" [equivalence]
    simulation 1:
      model dcmtrCtrl_PID, harness dcmtrCtrl_PID_Harness0
      post-load callback:
        sltest.testsequence.editStep('dcmtrCtrl_PID_Harness0/Test Assessment',...
        'MONITOR_MAX_VOLT','Action','verify( abs(V) <= 5)');
    simulation 2:
      model dcmtrCtrl_PID, harness dcmtrCtrl_PID_Harness0, mode Software-in-the-Loop (SIL)
      post-load callback: same code as in post-load callback of case "Confirm SIL Equivalence"
    equivalence criteria (2 of 3 signals compared)
      v
      angle